# Grasshopper definition FV-LB01-direct-sun-hours.gh (Grasshopper 1.0.8)

# ---- group: 01 Sun: Istanbul study location, 21 June, 4 steps per hour
analysisperiod = LBAnalysisPeriod(start_month=6, start_day=21, start_hour=0, end_month=6, end_day=21, end_hour=23, timestep=4)  # -> period, hoys, dates; plug-in component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
# LB-01  Potential direct sun hours at the glass, with and without the Folded Veil. Geometric only.
constrloc = LBConstructLocation(name="Istanbul study location", latitude=40.99329222, longitude=29.06462667, time_zone=3, elevation=0)  # -> location; plug-in component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
sunpath = LBSunPath(location=constrloc, hoys=analysisperiod.hoys, scale=1)  # -> report, vectors, altitudes, azimuths, hoys, sun_pts, analemma, daily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; plug-in component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

# ---- group: 02 Shared inputs: same glass, same vectors, same legend
legendpar = LBLegendParameters(min=0, max=7.5)  # -> leg_par; plug-in component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
veil_context_88 = Mesh([<mesh referenced from the Rhino model> x88])
glass_88 = Mesh([<mesh referenced from the Rhino model> x88])
run = BooleanToggle(True)

# ---- group: 03 Case A: glass with nothing in front (expect a uniform result)
a_glass_only = LBDirectSunHours(
    vectors=flatten(sunpath.vectors),
    timestep=4,
    geometry=flatten(glass_88),
    grid_size=0.25,
    offset_dist=0.01,
    geo_block=True,
    legend_par=legendpar,
    run=run)  # -> report, points, results, mesh, legend, title, int_mtx; plug-in component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
a_glass_only_range = Bounds(Numbers=flatten(a_glass_only.results))
a_glass_only_mean = Average(Input=flatten(a_glass_only.results))
a_glass_only_mean_h = Panel(a_glass_only_mean)
a_glass_only_min_to_max_h = Panel(a_glass_only_range)
_21_m = UnitY(Factor=21)
a_shown_21_m_north = Move(Geometry=a_glass_only.mesh, Motion=_21_m)  # -> Geometry, Transform

# ---- group: 04 Case B: same glass, veil as context
b_glass_veil = LBDirectSunHours(
    vectors=flatten(sunpath.vectors),
    timestep=4,
    geometry=flatten(glass_88),
    context=flatten(veil_context_88),
    grid_size=0.25,
    offset_dist=0.01,
    geo_block=True,
    legend_par=legendpar,
    run=run)  # -> report, points, results, mesh, legend, title, int_mtx; plug-in component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
b_glass_veil_range = Bounds(Numbers=flatten(b_glass_veil.results))
b_glass_veil_mean = Average(Input=flatten(b_glass_veil.results))
b_glass_veil_mean_h = Panel(b_glass_veil_mean)
b_glass_veil_min_to_max_h = Panel(b_glass_veil_range)
