# Grasshopper definition FV-folded-veil.gh (Grasshopper 1.0.8)

# ---- group: 01 Inputs: Dmax and entrance centre (9, 0, 0)
entrance_centre = ConstructPoint(XCoordinate=9, YCoordinate=0, ZCoordinate=0)
# Folded Veil  |  free radial field  |  regenerates rhino/FV-folded-veil-reference.3dm
dmax_m = Slider(0.9, range=0.2..0.9)

# ---- group: 02 Unit grid: 96 positions less 8 at the 6 x 3 m entrance = 88, FV-001 to FV-088 order
rows_0_7 = Series(Start=0, Step=1, Count=8)
cols_0_11 = Series(Start=0, Step=1, Count=12)
entrance_indices = Integer([4, 5, 6, 7, 16, 17, 18, 19])
row_major = CrossReference(ListA=cols_0_11, ListB=rows_0_7, CrossMode=1)  # -> ListA, ListB
rows_88 = CullIndex(List=row_major.ListB, Indices=entrance_indices, Wrap=True)
cols_88 = CullIndex(List=row_major.ListA, Indices=entrance_indices, Wrap=True)
row_0_5 = Addition(A=rows_88, B=0.5)
col_0_5 = Addition(A=cols_88, B=0.5)
cz = Multiplication(A=row_0_5, B=1.5)
cx = Multiplication(A=col_0_5, B=1.5)
unit_centres = ConstructPoint(XCoordinate=cx, YCoordinate=0, ZCoordinate=cz)

# ---- group: 03 Radial field f: a design decision, not a solar result
distance_to_entrance = Distance(PointA=unit_centres, PointB=entrance_centre)
range = Bounds(Numbers=distance_to_entrance)
f = RemapNumbers(Value=distance_to_entrance, Source=range, Target=Domain(0, 1))  # -> Mapped, Clipped

# ---- group: 04 Depth d = 0.12 + (Dmax - 0.12) f Aperture r = 0.75 (0.87 - 0.45 f)
dmax_0_12 = Subtraction(A=dmax_m, B=0.12)
dmax_0_12_f = Multiplication(A=f.Mapped, B=dmax_0_12)
_0_3375_f = Multiplication(A=f.Mapped, B=-0.3375)
d = Addition(A=dmax_0_12_f, B=0.12)
r = Addition(A=_0_3375_f, B=0.6525)

# ---- group: 05 Eight vertices per unit, one branch per unit
a_x_offsets = Number([0.75, -0.75, -0.75, 0.75, 0, 0, 0, 0])
a_z_offsets = Number([0.75, 0.75, -0.75, -0.75, 0, 0, 0, 0])
b_x_signs = Number([0, 0, 0, 0, 1, 0, -1, 0])
b_z_signs = Number([0, 0, 0, 0, 0, 1, 0, -1])
b_y_signs = Number([0, 0, 0, 0, -1, -1, -1, -1])
cx_a = Addition(A=graft(cx), B=a_x_offsets)
cz_a = Addition(A=graft(cz), B=a_z_offsets)
bx_r = Multiplication(A=b_x_signs, B=graft(r))
bz_r = Multiplication(A=b_z_signs, B=graft(r))
y = Multiplication(A=b_y_signs, B=graft(d))
x = Addition(A=cx_a, B=bx_r)
z = Addition(A=cz_a, B=bz_r)
_8_vertices = ConstructPoint(XCoordinate=x, YCoordinate=y, ZCoordinate=z)

# ---- group: 06 Mesh: faces (i, j, 4+j) and (i, 4+j, 4+i)
face_a = Integer([0, 0, 1, 1, 2, 2, 3, 3])
face_b = Integer([1, 5, 2, 6, 3, 7, 0, 4])
face_c = Integer([5, 4, 6, 5, 7, 6, 4, 7])
_8_faces = MeshTriangle(CornerA=face_a, CornerB=face_b, CornerC=face_c)
veil_units = ConstructMesh(Vertices=_8_vertices, Faces=_8_faces)

# ---- group: 07 Preview coloured by f
colour_by_f = Gradient(LowerLimit=0, UpperLimit=1, Parameter=graft(f.Mapped), stops=[0.15: RGB(255, 130, 160), 0.85: RGB(220, 0, 40)])
veil_preview = CustomPreview(Geometry=veil_units, Material=colour_by_f)

# ---- group: 08 Check: must match the reference Rhino file at Dmax 0.90
# Reference: Reference: 88 units, 704 triangles, 249.35 m2, depth [120.0, 900.0] mm
depth_range_m = Bounds(Numbers=flatten(d))
units = ListLength(List=flatten(veil_units))
deconstruct = DeconstructMesh(Mesh=veil_units)  # -> Vertices, Faces, Colours, Normals
area = Area(Geometry=veil_units)  # -> Area, Centroid
triangles = ListLength(List=flatten(deconstruct.Faces))
total_m2 = MassAddition(Input=flatten(area.Area))  # -> Result, PartialResults
units_2 = Panel(units)
triangles_2 = Panel(triangles)
total_m2_2 = Panel(total_m2.Result)
depth_range = Panel(depth_range_m)
